# Grasshopper definition Computer Instructor.gh (Grasshopper 0.9.76)
# plug-ins: Python Interpreter

# genome 1
# PROPLEMS
# 1. reverse list of geometry - recognize list as geometry
api_token_from_rescue_time = Panel("B63nQUnHmT5f18uOaPp6uGQRwWiIBEsnbP0wwL8l")
pull_my_data_from_rescuetime = PythonScript(Send=Toggle(False), key=api_token_from_rescue_time)  # -> out, Response
# ---------- pull_my_data_from_rescuetime: Python ----------
## MAKE LIBRARIES IMPORTABLE ##
import sys, os
libraryPath = os.path.dirname(sys.path[0]) + "\_LIBRARIES"
if not libraryPath in sys.path:
    sys.path.append(libraryPath)
################################

import urllib, urllib2
import re
import json

class Row(object):
    duration = None
    title = None
    category = None

    def __init__(self, data_row):
        self.duration = data_row[1]
        self.activity = data_row[3]
        self.category = data_row[4]


if Send:
    try:
        url = 'https://www.rescuetime.com/anapi/data'
        values = {
            'key' : "B63nQUnHmT5f18uOaPp6uGQRwWiIBEsnbP0wwL8l",
            'format' : 'json',
            'restrict_begin' : '2015-12-19',
            'restrict_end' : '2015-12-20'
            }

        data = urllib.urlencode(values)
        req = urllib2.Request(url, data)
        raw_response = urllib2.urlopen(req)
        response_str = raw_response.read()

        table = json.loads(response_str)
        data_header = table["row_headers"]
        data_rows = table["rows"]

        rows = []
        for data_row in data_rows:
            row = Row(data_row)
            rows.append(row)
        Response = "\n".join(map(lambda row: row.activity + ", " + str(row.duration), rows))

    except Exception as e:
        Response = str(e)
        print str(e)
# ---------- end pull_my_data_from_rescuetime ----------
rescuetime_daily_programs_used_total_sec = Panel(pull_my_data_from_rescuetime.Response)  # "RescueTime daily programs used/ total seconds"
rec = DataRecorder(DataLimit=-10, RecordData=True)
panel = Panel(rec)
list_of_task_and_interruptions = Panel("""rhino, 8009
Google Spreadsheets, 3487
Gmail, 574
news.google.com, 439
google.com, 432
rescuetime.com, 339
cnn.com, 229
theatlantic.com, 224
thedsgnblog.com, 63
snippingtool, 26
 """)
split = TextSplit(Text=list_of_task_and_interruptions)
panel_2 = Panel(split)
split_2 = TextSplit(Text=split, Separators=",")
panel_4 = Panel(split_2)
flip = FlipMatrix(Data=split_2)
panel_5 = Panel(flip)
task_code = Panel("3")
rep = ReplaceText(Text=panel_5, Find="rhino", Replace=task_code, RecursiveReplace=False)
task_code_2 = Panel("1")
panel_6 = Panel("{1}")
panel_7 = Panel(rep)
split_3 = SplitTree(Data=panel_5, Masks=flatten("{0;0;0}"))  # -> Positive, Negative
total_seconds_worked_day = Panel(split_3.Negative)
rep_2 = ReplaceText(Text=rep, Find="rescuetime.com", Replace=task_code_2, RecursiveReplace=False)
ma = MassAddition(Input=split_3.Negative)  # -> Result, PartialResults
task_code_3 = Panel("0")
total_seconds_day = Panel(ma.Result)
division = Division(A=split_3.Negative, B=total_seconds_day)
percent_of_day_by_task = Panel(division)
multiplication = Multiplication(A=percent_of_day_by_task, B=Slider(100, range=0..100))
rep_3 = ReplaceText(Text=rep_2, Find="Google Spreadsheets", Replace=task_code_3, RecursiveReplace=False)
panel_8 = Panel(multiplication)
panel_9 = Panel(rep_3)
interruption_code = Panel("a")
multiplication_2 = Multiplication(A=percent_of_day_by_task, B=Slider(19, range=0..100))
panel_10 = Panel(multiplication_2)
rep_4 = ReplaceText(Text=rep_3, Find="news.google.com", Replace=interruption_code, RecursiveReplace=False)
int = Integer(panel_8)
panel_11 = Panel(rep_4)
panel_12 = Panel(int)
interruption_code_2 = Panel("a")
rep_5 = ReplaceText(Text=panel_11, Find="time.com", Replace=interruption_code_2, RecursiveReplace=False)
interruption_code_3 = Panel("a")
panel_13 = Panel(rep_5)
rep_6 = ReplaceText(Text=panel_13, Find="cnn.com", Replace=interruption_code_3, RecursiveReplace=False)
interruption_code_4 = Panel("a")
panel_14 = Panel(rep_6)
rep_7 = ReplaceText(Text=panel_14, Find="theatlantic.com", Replace=interruption_code_4, RecursiveReplace=False)
panel_15 = Panel(rep_7)
interruption_code_5 = Panel("b")
rep_8 = ReplaceText(Text=panel_15, Find="Gmail", Replace=interruption_code_5, RecursiveReplace=False)
task_code_4 = Panel("0")
panel_16 = Panel(rep_8)
rep_9 = ReplaceText(Text=panel_16, Find="Google Spreadsheets", Replace=task_code_4, RecursiveReplace=False)
interruption_code_6 = Panel("c")
panel_17 = Panel(rep_9)
rep_10 = ReplaceText(Text=panel_16, Find="google.com", Replace=interruption_code_6, RecursiveReplace=False)
panel_18 = Panel(rep_10)
interruption_code_7 = Panel("e")
rep_11 = ReplaceText(Text=rep_10, Find="thedsgnblog.com", Replace=interruption_code_7, RecursiveReplace=False)
panel_19 = Panel(rep_11)
interruption_code_8 = Panel("d")
rep_12 = ReplaceText(Text=rep_11, Find="snippingtool", Replace=interruption_code_8, RecursiveReplace=False)
panel_20 = Panel(rep_12)
coded_tasks_and_interruptions = Panel(panel_20)
int_2 = Integer(flatten(multiplication_2))
number_of_times_for_code_to_appear = Panel(int_2)
split_4 = SplitTree(Data=coded_tasks_and_interruptions, Masks=flatten("{0;0;1}"))  # -> Positive, flatten(Negative)
total_seconds_worked_day_2 = Panel(split_4.Negative)
number_slider = Slider(1, range=0..100)
number_slider_2 = Slider(2, range=0..100)
number_slider_3 = Slider(3, range=0..100)
number_slider_4 = Slider(4, range=0..100)
duplicate_task_int_by_multiplier = DuplicateTaskIntByMultiplier(L=int_2, i=number_slider, L_2=split_4.Negative, i_2=number_slider)  # -> panel_2, R
duplicate_task_int_by_multiplier_2 = DuplicateTaskIntByMultiplier(L=int_2, i=number_slider_2, L_2=split_4.Negative, i_2=number_slider_2)  # -> panel_2, R
duplicate_task_int_by_multiplier_3 = DuplicateTaskIntByMultiplier(L=int_2, i=number_slider_3, L_2=split_4.Negative, i_2=number_slider_3)  # -> panel_2, R
duplicate_task_int_by_multiplier_4 = DuplicateTaskIntByMultiplier(L=int_2, i=number_slider_4, L_2=split_4.Negative, i_2=number_slider_4)  # -> panel_2, R
number_slider_5 = Slider(2, range=0..100)
number_slider_6 = Slider(1, range=0..100)
panel_21 = Panel(duplicate_task_int_by_multiplier.R)
panel_22 = Panel(duplicate_task_int_by_multiplier_2.R)
panel_23 = Panel(duplicate_task_int_by_multiplier_3.R)
number_slider_7 = Slider(0, range=0..100)
duplicate_task_int_by_multiplier_5 = DuplicateTaskIntByMultiplier(L=int_2, i=number_slider_7, L_2=split_4.Negative, i_2=number_slider_7)  # -> panel_2, R
panel_24 = Panel(duplicate_task_int_by_multiplier_5.R)
panel_25 = Panel(duplicate_task_int_by_multiplier_4.R)
number_slider_8 = Slider(3, range=0..100)
join = TextJoin(Text=[panel_22, panel_23, panel_25])  # -> flatten(Result)
join_2 = TextJoin(Text=[panel_24, panel_21])  # -> flatten(Result)
daily_tasks = Panel(join_2)
item = ListItem(List=split_4.Negative, Index=number_slider_8, Wrap=True)
item_2 = ListItem(List=int_2, Index=number_slider_8, Wrap=True)
item_3 = ListItem(List=split_4.Negative, Index=number_slider_5, Wrap=True)
item_4 = ListItem(List=int_2, Index=number_slider_5, Wrap=True)
item_5 = ListItem(List=split_4.Negative, Index=number_slider_6, Wrap=True)
item_6 = ListItem(List=int_2, Index=number_slider_6, Wrap=True)
item_7 = ListItem(List=split_4.Negative, Index=number_slider_7, Wrap=True)
item_8 = ListItem(List=int_2, Index=number_slider_7, Wrap=True)
daily_interruptions = Panel(join)
dup = DuplicateData(Data=item, Number=item_2, Order=True)
dup_2 = DuplicateData(Data=item_3, Number=item_4, Order=True)
dup_3 = DuplicateData(Data=item_5, Number=item_6, Order=True)
dup_4 = DuplicateData(Data=item_7, Number=item_8, Order=True)
panel_26 = Panel(dup)
panel_27 = Panel(dup_2)
panel_28 = Panel(dup_3)
panel_29 = Panel(dup_4)
jitter = Jitter(List=daily_tasks, Jitter=Slider(0.74, range=0..1), Seed=2)  # -> Values, Indices
merge = Merge(Data1=panel_29, Data2=panel_28, Data3=panel_27, Data4=panel_26)
panel_30 = Panel(jitter.Values)
panel_31 = Panel(merge)
number_slider_9 = Slider(0.9, range=0..1)
number_slider_10 = Slider(0.1, range=0..1)
merge_2 = Merge(Data1=panel_31, Data2=graft("e"), Data3=graft("c"), Data4=graft("2"), Data5=graft("4"))
panel_32 = Panel(merge_2)
jitter_2 = Jitter(List=panel_31, Jitter=number_slider_10, Seed=number_slider_9)  # -> Values, Indices
panel_33 = Panel(jitter_2.Values)
jitter_3 = Jitter(List=panel_32, Jitter=number_slider_10, Seed=number_slider_9)  # -> Values, Indices
join_3 = TextJoin(Text=panel_33)  # -> flatten(Result)
panel_34 = Panel(jitter_3.Values)
join_4 = TextJoin(Text=panel_34)  # -> flatten(Result)
panel_35 = Panel(join_4)
galapagos = Galapagos(fitness=day_switching_cost_based_on_task_profile, gene=[number_slider_9, number_slider_10])
day_switching_cost_based_on_task_profile = PythonScript(InputGenome=panel_35, Send=Toggle(True))  # -> out, Response
# ---------- day_switching_cost_based_on_task_profile: Python ----------
# Expects inputs:
#   InputGenome
#   Send
# Expects outputs:
#   Response

data = """TASK TYPE	z	a	b	c	d	e	avg	da	db	dc	dd	de
ROTE TASK: draw 20 square rooms as well as you can and align them in a grid	114	302	108	112	122	105	149	152	-41	-37	-27	-44
LOGICAL TASK: organize the given rooms based on area	64	110	109	94	88	92	98	11	10	-4	-10	-6
MEMORY TASK: draw a cross section of the pantheon	62	80	102	190	100	103	115	-35	-13	75	-15	-12
SPATIAL DESIGN TASK: layout furniture in the given apartment	123	143	161	174	154	178	162	-19	-1	12	-8	16
CREATIVE DESIGN TASK: design a 4'x8' facade panel in the given space	64	123	132	201	123	225	160	-37	-28	40	-37	64
"""

interruptions = """a.   INTERRUPTION: read the headline in Google News
b.   INTERRUPTION: describe what you are working on in a single sentence and send it as an email to yourself
c.   INTERRUPTION: Google search images related to the task you are working on
d.   INTERRUPTION: send an image from Google to yourself
e.   INTERRUPTION: check a design blog"""

import operator


class Task(object):
    shortcut = None
    title = None
    interruptions = None
    baseline_interruption = None

    def __init__(self, shortcut, title):
        self.shortcut = shortcut
        self.title = title
        self.interruptions = {}

    def __str__(self):
        return self.title

    @property
    def baseline_cost(self):
        if self.baseline_interruption is None:
            return None

        return self.interruptions[self.baseline_interruption]

    # Given an Interruption, give the cost of performing this task under the interruption.
    def cost(self, interruption):
        # More time is worse. So define cost simply by the amount of time it took
        # to complete beyond the baseline cost, which had no interruptions.
        return self.interruptions[interruption] - self.baseline_cost


class Interruption(object):
    shortcut = None
    title = None
    tasks = {}

    def __init__(self, shortcut, title):
        self.shortcut = shortcut
        self.title = title

    def __str__(self):
        return self.title

class DataModel(object):
    interruptions = []
    tasks = []

    tasks_lut = {}
    interruptions_lut = {}

    def __init__(self):
        pass

    def __str__(self):
        tr = ""
        for interruption in self.interruptions:
            tr += str(interruption)
            tr += "\n"
        for task in self.tasks:
            tr += str(task)
            tr += "\n"
        return tr

    def __getitem__(self, char):
        if char in self.interruptions_lut:
            return self.interruptions_lut[char]
        if char in self.tasks_lut:
            return self.tasks_lut[char]
        return None

    def add_task(self, task):
        self.tasks.append(task)
        self.tasks_lut[task.shortcut] = task

    def add_interruption(self, interruption):
        self.interruptions.append(interruption)
        self.interruptions_lut[interruption.shortcut] = interruption

class Parser(object):
    to_parse = None
    data_model = None
    def __init__(self, to_parse):
        self.to_parse = to_parse
        self.data_model = DataModel()

        self.parse()

    def parse(self):
        self.parse_interruptions()
        self.parse_tasks()
        self.parse_profile()

    def parse_interruptions(self):
        header_row = self.to_parse.split("\n")[0]

        cells = header_row.split("\t")
        baseline = Interruption("z", "z.   BASELINE: No interruptions")
        self.data_model.add_interruption(baseline)

        lut = {"a":0, "b":1, "c":2, "d":3, "e":4}

        interruption_titles = interruptions.split("\n")
        for shortcut in cells[2:7]:
            title = interruption_titles[lut[shortcut]]
            interruption = Interruption(shortcut, title)
            self.data_model.add_interruption(interruption)

    def parse_tasks(self):
        body_rows = self.to_parse.split("\n")[1:-1]

        for i in range(len(body_rows)):
            line = body_rows[i]
            cells = line.split("\t")
            task = Task(str(i + 1), cells[0])
            self.data_model.add_task(task)

    # After the interruptions and tasks are created, fill both with the
    # data from the user's profile.
    def parse_profile(self):
        assert len(self.data_model.interruptions) > 0, "Interruptions must be parsed before profile."
        assert len(self.data_model.tasks) > 0, "Tasks must be parsed before profile."

        rows = self.to_parse.split("\n")
        for i in range(0, len(rows) - 2):
            row = rows[i + 1]
            cells = row.split("\t")

            task = self.data_model.tasks[i]

            baseline = self.data_model.interruptions[0]
            task.baseline_interruption = baseline

            for j in range(0, 6):
                cell = cells[j + 1]
                interruption = self.data_model.interruptions[j]
                interruption.tasks[task] = float(cell)
                task.interruptions[interruption] = float(cell)


class Prioritizer(object):
    data_model = None

    def __init__(self, data_model):
        self.data_model = data_model

    # Given an Interruption, return a sorted array of Tasks that are conducive to
    # the given Interruption.
    def get_prioritized_tasks(self, interruption):
        assert interruption in self.data_model.interruptions, "Got an Interruption that wasn't in the given DataModel"

        # First, duplicate the dictionary so we don't alter it.
        tasks = interruption.tasks.copy()
        # Make it a dictionary from Task to cost (instead of Task to time score).
        for task, score in tasks.iteritems():
            tasks[task] = task.cost(interruption)

        # Sort it by cost.
        sorted_by_cost = sorted(tasks.items(), key=operator.itemgetter(1))
        # Convert to a list of Tasks (instead of a list of tuples)
        sorted_tasks = map(lambda x: x[0], sorted_by_cost)

        return sorted_tasks


class Genome(object):
    data_model = None
    genome_string = None

    def __init__(self, data_model, genome_string):
        self.data_model = data_model
        self.genome_string = genome_string

    @property
    def cost(self):
        cost = 0.0
        current_task = None
        last_interruption = None
        number_of_tasks = 0.0

        for char in self.genome_string:
            value = self.data_model[char]
            if value is None:
                continue
            if value.__class__ is Task:
                current_task = value
                number_of_tasks += 1.0
                continue
            if value.__class__ is Interruption:
                last_interruption = value
                cost += current_task.cost(last_interruption)
                continue
        return cost / number_of_tasks


if __name__ == "__main__" and Send and InputGenome is not None:
    parser = Parser(data)
    data_model = parser.data_model
    genome = Genome(data_model, InputGenome)
    Response = genome.cost

# end of file
# ---------- end day_switching_cost_based_on_task_profile ----------
daily_switching_cost = Panel(day_switching_cost_based_on_task_profile.Response)

# ==== cluster DuplicateTaskIntByMultiplier
L = ClusterInput()
i = ClusterInput()
L_2 = ClusterInput()
i_2 = ClusterInput()
item = ListItem(List=L, Index=i, Wrap=True)
item_2 = ListItem(List=L_2, Index=i_2, Wrap=True)
dup = DuplicateData(Data=item_2, Number=item, Order=True)
panel = Panel(dup)
join = TextJoin(Text=panel)
R = ClusterOutput(join)
panel_2 = ClusterOutput(panel)
