# Grasshopper definition RescueTime Software Tracker.gh (Grasshopper 0.9.76)
# plug-ins: Python Interpreter, Human

# Date Range
toggle = BooleanToggle(True)
# RescueTimeAPI
getrescuetimedata = PythonScript(Send=toggle, RestrictBegin="2016-3-3", RestrictEnd="2016-3-3")  # -> out, Response
# ---------- getrescuetimedata: Python ----------
import urllib, urllib2
import re
import json

# Send = True

def get_stats(api_key):
    print "making a request using key %s" % api_key

    url = 'https://www.rescuetime.com/anapi/data'
    values = {
        'key' : api_key,
        'format' : 'json',
        'restrict_begin' : RestrictBegin,
        'restrict_end' : RestrictEnd,
        'resolution_time' : 'hour',
        'perspective': 'interval'
        }

    data = urllib.urlencode(values)
    req = urllib2.Request(url, data)
    raw_response = urllib2.urlopen(req)
    response_str = raw_response.read()

    table = json.loads(response_str)
    data_rows = table["rows"]
    print "  Got %d rows of data" % len(data_rows)
    return data_rows

if Send:
    try:
        exceptions = {
            "adobe illustrator cc 2015": "Adobe Illustrator",
            "rhinoceros": "rhino",
            "rhino4": "rhino",
        }

        def process_exceptions(activity):
            for (exception, alias) in exceptions.iteritems():
                if activity == exception:
                    activity = alias
                    break
            return activity

        api_keys = [
            'B63nQUnHmT5f18uOaPp6uGQRwWiIBEsnbP0wwL8l', # Violet!
            'B63ULEKSgemtqKY93UVjIUJVZjeurPcJvsA6mMvG',
            'B63EIH0Rb1smaLFgUI75MlvJTRcOOdri_pHEESDH',
            'B630txyqhWpHBm4LdfaqK7Y8_h4VpZZDTfgrnpG5',
            'B632E77J2gwE72Tx1tek9e7ln6TzPQNa7iDYCdQG',
            'B63b096NuvezaEI_8i_ILG2OWLXwfgHL7ltM51h5',
            'B63gHzGHufRyMxKXhx8ZD_YYSq2IFqoYa1Jcx4oY',
            'B63BeR7IQcoyYt0LAQ1awiOiIX6kX_XcuEFQLllJ',
            'B63XiHLhGV8lnxg1e3jQNflJkGA1tq1daSIoq29F',
            'B630JDCL9jJDqrcOy5bncfWlEn_q1645xbDemG6u',
            'B63Sk4ZYzW95ayJdKKzhD8CfRHJEI0OHyyE_lKS5'
            ]

        # Date to table of programs
        aggregated_stats = {}

        for key in api_keys:
            # Make the API request to Rescuetime.
            stats = get_stats(key)

            # Loop through all the activities and add them to the aggregated
            # table.
            for row in stats:
                # Extract the values we want.
                date = row[0]
                time_spent = row[1]
                activity = row[3]

                # Process all the "exceptions", in which the same application
                # might have different names.
                activity = process_exceptions(activity)

                # Populate the aggregation table if we haven't seen this date yet.
                if date not in aggregated_stats:
                    aggregated_stats[date] = {}

                # Populate the subtable containing activities if we haven't
                # seen this activity yet.
                if activity not in aggregated_stats[date]:
                    aggregated_stats[date][activity] = 0

                # Add the time spent to the activity. This is the actual
                # aggregation step where time spent on the same activity
                # is added from multiple users.
                aggregated_stats[date][activity] += time_spent

        # This will hold the flat list of activities.
        final_list = []

        # Find a list of the hours sorted from start to end.
        hours = []
        for (hour, stats_table) in aggregated_stats.iteritems():
            hours.append(hour)
        hours = sorted(hours)

        # Start to format the time table as a flat list of events.
        for hour in hours:
            stats_table = aggregated_stats[hour]
            table_this_hour = []

            for (activity, aggregated_time_spent) in stats_table.iteritems():
                # This is the format of each row.
                row = [hour, activity, aggregated_time_spent]
                # Add it to the table holding the current hour's activities.
                table_this_hour.append(row)

            # Sort the current hour in reverse from most used application
            # to least used.
            table_this_hour = sorted(
                table_this_hour,
                key=lambda row: -row[2]
                )

            # Add this hourly table to the final list of all activities.
            final_list += table_this_hour

        # If you want to see the table, uncomment the following two lines.
        # for row in final_list:
        #     print row
        print "Done. %d rows in the table." % len(final_list)
        
        # Format this list into a Grasshopper-friendly format.
        grasshopper_list = []
        for row in final_list:
            gs_row = "%s, %s, %d" % (row[0], row[1], row[2])
            grasshopper_list.append(gs_row)

        # "Response" is the variable that Grasshopper expects as an output.
        Response = grasshopper_list

    except Exception as e:
        # OOPS! Something went wrong.
        Response = str(e)
        print str(e)
# ---------- end getrescuetimedata ----------

rawoutput = Panel(getrescuetimedata.Response)

number_slider = Slider(12, range=0..100)
tag = TextTag3D(Text="rhino", Size=Slider(20, range=0..100), Colour=ColourSwatch(SwatchColor=RGB(13, 7, 255)), Justification=7)
bake_with_attributes = BooleanToggle(False)

# ----
# Hour Range
panel = Panel("2016-02-17T00:00:00, ")

rep = ReplaceText(
    Text=[panel, "2016-02-17T01:00:00, ", "2016-02-17T02:00:00, ", "2016-02-17T03:00:00, ", "2016-02-17T04:00:00, ", "2016-02-17T05:00:00, ", "2016-02-17T06:00:00, ", "2016-02-17T07:00:00, ", "2016-02-17T08:00:00, ", "2016-02-17T09:00:00, ", "2016-02-17T10:00:00, ", "2016-02-17T11:00:00, ", "2016-02-17T12:00:00, ", "2016-02-17T13:00:00, ", "2016-02-17T14:00:00, ", "2016-02-17T15:00:00, ", "2016-02-17T16:00:00, ", "2016-02-17T17:00:00, ", "2016-02-17T18:00:00, ", "2016-02-17T19:00:00, ", "2016-02-17T20:00:00, ", "2016-02-17T21:00:00, ", "2016-02-17T22:00:00, ", "2016-02-17T23:00:00, "],
    Find="02-17",
    Replace="03-03",
    RecursiveReplace=False)

graft = GraftTree(Tree=rep, IncludeEmptyLists=True, IncludeNullItems=True)

# ----
# Parse
parse = Parse(allrescuetimedata=getrescuetimedata.Response, hourrange=graft)  # -> totalsecondsusedinentireset, totalsecondsusedinhour, program, B, B_2
panel_2 = Panel(graft)
# Average
division = Division(A=parse.B, B=parse.totalsecondsusedinhour)

# ----
# Scoreboard
total_seconds_used_in_entire_set = Panel(parse.totalsecondsusedinentireset)
seconds_hour = Panel(parse.B)
programs_hour = Panel(parse.program)
total_seconds_hour = Panel(parse.totalsecondsusedinhour)
average_time_used_in_program_hour = Panel(division)

lng = ListLength(List=flatten(graft))
panel_3 = Panel(rep)

# ----
# #Top Programs
gettopprograms = GetTopPrograms(listofall=parse.B_2, numberoftopprograms=3)
listoftopprograms = Panel(gettopprograms)
list = ItemSelector(
    gettopprograms,
    {"academia.edu", "Adobe Illustrator", "Adobe InDesign", "Adobe Reader", "Calculator", "Desktop Window Manager", "drive.google.com", "facebook.com", "google.com", "hparc.com", "hulu.com", "inbox.google.com", "landscapeurbanism.aaschool.ac.uk", "libreoffice", "netflix.com", "nordstromrack.com", "play.spotify.com", "quicktime player", "rhino", "Skype", "Windows Explorer"}, selected="academia.edu")

type = Type(averagetimeusedperhr=division, program="iTunes", programs_hr=parse.program)
type_2 = Type(averagetimeusedperhr=division, program="facebook.com", programs_hr=parse.program)
type_3 = Type(averagetimeusedperhr=division, program="vimeo.com", programs_hr=parse.program)
type_4 = Type(averagetimeusedperhr=division, program="netflix.com", programs_hr=parse.program)
type_5 = Type(averagetimeusedperhr=division, program="drive.google.com", programs_hr=parse.program)
type_6 = Type(averagetimeusedperhr=division, program="Windows Explorer", programs_hr=parse.program)
type_7 = Type(averagetimeusedperhr=division, program="MS Word", programs_hr=parse.program)
type_8 = Type(averagetimeusedperhr=division, program="arcmap", programs_hr=parse.program)
type_9 = Type(averagetimeusedperhr=division, program="Adobe Illustrator", programs_hr=parse.program)
type_10 = Type(averagetimeusedperhr=division, program="rhino", programs_hr=parse.program)
type_11 = Type(averagetimeusedperhr=division, program="Adobe Photoshop", programs_hr=parse.program)
type_12 = Type(averagetimeusedperhr=division, program="Adobe InDesign", programs_hr=parse.program)
type_13 = Type(averagetimeusedperhr=division, program="3D Studio Max", programs_hr=parse.program)

line = Line(Line((10, 0, 0), (10, 188.7395673, 0)))
panel_4 = Panel(lng)
divide = DivideCurve(Curve=line, TimeInHours=panel_4, Kinks=False)  # -> Points, Tangents, Parameters

# ----
# Baseline
number_slider_2 = Slider(7, range=0..10)
neg = Negative(Value=number_slider_2)
X = UnitX(Factor=flatten(neg))
move = Move(Geometry=divide.Points, Motion=X)  # -> Geometry, Transform

intcrv = Interpolate(Vertices=divide.Points, Degree=3, Periodic=False, KnotStyle=1)  # -> Curve, Length, Domain

# ----
# Baseline
number_slider_3 = Slider(7, range=0..10)
neg_2 = Negative(Value=number_slider_3)
X_2 = UnitX(Factor=flatten(neg_2))
move_2 = Move(Geometry=intcrv.Curve, Motion=X_2)  # -> Geometry, Transform

# ----
# Baseline
number_slider_4 = Slider(3, range=0..10)
neg_3 = Negative(Value=number_slider_4)
X_3 = UnitX(Factor=flatten(neg_3))
move_3 = Move(Geometry=intcrv.Curve, Motion=X_3)  # -> Geometry, Transform

number_slider_5 = Slider(46, range=0..100)
graphbyhour = GraphByHour(startingcurve=move_3.Geometry, startingpoints=divide.Points, programuse=type_10, multiplier=number_slider_5)  # -> resultingpoints, loft_2, resultingcurve
preview = CustomPreview(Geometry=graphbyhour.loft_2, Shader=ColourSwatch(SwatchColor=RGB(255, 255, 255)))

graphbyhour_2 = GraphByHour(
    startingcurve=graphbyhour.resultingcurve,
    startingpoints=graphbyhour.resultingpoints,
    programuse=type_13,
    multiplier=number_slider_5)  # -> resultingpoints, loft_2, resultingcurve

number_slider_6 = Slider(12, range=0..100)
graphbyhour_3 = GraphByHour(
    startingcurve=graphbyhour_2.resultingcurve,
    startingpoints=graphbyhour_2.resultingpoints,
    programuse=type_9,
    multiplier=number_slider_5)  # -> resultingpoints, loft_2, resultingcurve
preview_2 = CustomPreview(Geometry=graphbyhour_3.loft_2, Shader=ColourSwatch(SwatchColor=RGB(245, 0, 255)))

number_slider_7 = Slider(12, range=0..100)
graphbyhour_4 = GraphByHour(
    startingcurve=graphbyhour_3.resultingcurve,
    startingpoints=graphbyhour_3.resultingpoints,
    programuse=type_12,
    multiplier=number_slider_5)  # -> resultingpoints, loft_2, resultingcurve
preview_3 = CustomPreview(Geometry=graphbyhour_4.loft_2, Shader=ColourSwatch(SwatchColor=RGB(0, 170, 255)))

number_slider_8 = Slider(12, range=0..100)
graphbyhour_5 = GraphByHour(
    startingcurve=graphbyhour_4.resultingcurve,
    startingpoints=graphbyhour_4.resultingpoints,
    programuse=type_11,
    multiplier=number_slider_5)  # -> resultingpoints, loft_2, resultingcurve
preview_4 = CustomPreview(Geometry=graphbyhour_5.loft_2, Shader=ColourSwatch(SwatchColor=RGB(10, 255, 29)))

number_slider_9 = Slider(12, range=0..100)
graphbyhour_6 = GraphByHour(
    startingcurve=graphbyhour_5.resultingcurve,
    startingpoints=graphbyhour_5.resultingpoints,
    programuse=type_8,
    multiplier=number_slider_5)  # -> resultingpoints, loft_2, resultingcurve
preview_5 = CustomPreview(Geometry=graphbyhour_6.loft_2, Shader=ColourSwatch(SwatchColor=RGB(255, 0, 0)))

number_slider_10 = Slider(12, range=0..100)
graphbyhour_7 = GraphByHour(
    startingcurve=graphbyhour_6.resultingcurve,
    startingpoints=graphbyhour_6.resultingpoints,
    programuse=type_5,
    multiplier=number_slider_5)  # -> resultingpoints, loft_2, resultingcurve
preview_6 = CustomPreview(Geometry=graphbyhour_7.loft_2, Shader=ColourSwatch(SwatchColor=RGB(255, 126, 0)))

number_slider_11 = Slider(12, range=0..100)
graphbyhour_8 = GraphByHour(
    startingcurve=graphbyhour_7.resultingcurve,
    startingpoints=graphbyhour_7.resultingpoints,
    programuse=type_6,
    multiplier=number_slider_5)  # -> resultingpoints, loft_2, resultingcurve
preview_7 = CustomPreview(Geometry=graphbyhour_8.loft_2, Shader=ColourSwatch(SwatchColor=RGB(255, 255, 0)))

number_slider_12 = Slider(12, range=0..100)
graphbyhour_9 = GraphByHour(
    startingcurve=graphbyhour_8.resultingcurve,
    startingpoints=graphbyhour_8.resultingpoints,
    programuse=type_7,
    multiplier=number_slider_5)  # -> resultingpoints, loft_2, resultingcurve
preview_8 = CustomPreview(Geometry=graphbyhour_9.loft_2, Shader=ColourSwatch(SwatchColor=RGB(209, 52, 0)))

number_slider_13 = Slider(12, range=0..100)
graphbyhour_10 = GraphByHour(
    startingcurve=graphbyhour_9.resultingcurve,
    startingpoints=graphbyhour_9.resultingpoints,
    programuse=type_4,
    multiplier=number_slider_5)  # -> resultingpoints, loft_2, resultingcurve
preview_9 = CustomPreview(Geometry=graphbyhour_10.loft_2, Shader=ColourSwatch(SwatchColor=RGB(255, 0, 0)))

number_slider_14 = Slider(12, range=0..100)
graphbyhour_11 = GraphByHour(
    startingcurve=graphbyhour_10.resultingcurve,
    startingpoints=graphbyhour_10.resultingpoints,
    programuse=type_3,
    multiplier=number_slider_5)  # -> resultingpoints, loft_2, resultingcurve
preview_10 = CustomPreview(Geometry=graphbyhour_11.loft_2, Shader=ColourSwatch(SwatchColor=RGB(195, 132, 0)))

number_slider_15 = Slider(12, range=0..100)
graphbyhour_12 = GraphByHour(
    startingcurve=graphbyhour_11.resultingcurve,
    startingpoints=graphbyhour_11.resultingpoints,
    programuse=type,
    multiplier=number_slider_5)  # -> resultingpoints, loft_2, resultingcurve
preview_11 = CustomPreview(Geometry=graphbyhour_12.loft_2, Shader=ColourSwatch(SwatchColor=RGB(152, 100, 0)))

number_slider_16 = Slider(12, range=0..100)
graphbyhour_13 = GraphByHour(
    startingcurve=graphbyhour_12.resultingcurve,
    startingpoints=graphbyhour_12.resultingpoints,
    programuse=type_2,
    multiplier=number_slider_5)  # -> resultingpoints, loft_2, resultingcurve
preview_12 = CustomPreview(Geometry=graphbyhour_13.loft_2, Shader=ColourSwatch(SwatchColor=RGB(142, 7, 255)))

preview_13 = CustomPreview(Geometry=graphbyhour_2.loft_2, Shader=ColourSwatch(SwatchColor=RGB(69, 29, 255)))
graphbyhour_14 = GraphByHour(startingcurve=move_2.Geometry, startingpoints=divide.Points, programuse=type_13, multiplier=number_slider_5)  # -> resultingpoints, loft_2, resultingcurve
preview_14 = CustomPreview(Geometry=graphbyhour_14.loft_2, Shader=ColourSwatch(SwatchColor=RGB(69, 29, 255)))
geometrytobake = Geometry([graphbyhour.loft_2, graphbyhour_2.loft_2, graphbyhour_3.loft_2, graphbyhour_4.loft_2, graphbyhour_5.loft_2, graphbyhour_6.loft_2, graphbyhour_7.loft_2, graphbyhour_8.loft_2, graphbyhour_9.loft_2, graphbyhour_10.loft_2, graphbyhour_11.loft_2, graphbyhour_12.loft_2, graphbyhour_13.loft_2])
bakeattributes = CSharpScript(
    objs=geometrytobake,
    layers=["rhino", "3D Studio Max", "Adobe Illustrator", "Adobe InDesign", "Adobe Photoshop", "arcmap", "drive.google.com", "Windows Explorer", "MS Word", "netflix.com", "vimeo.com", "iTunes", "facebook.com"],
    activate=bake_with_attributes,
    groupListTgthr=Toggle(False))  # -> out; inputs objs: list, names: list of String, layers: list of String, colors: list of Color, pWidths: list of Double, wiresEach: list of Int32, materials: list, activate: Boolean, groupListTgthr: Boolean
# ---------- bakeattributes: C# ----------
    //Inserts geometry into the Rhino document, with custom attributes
    //Written by Giulio Piacentino
    //Version written 2011 10 18 - for Grasshopper 0.8.52

    if (activate)
    {
      int groupIndex = -1;
      if(groupListTgthr)
        groupIndex = doc.Groups.Add();

      for(int i = 0; i < objs.Count; i++)
      {
        object obj = objs[i];
        if(obj == null)
        {
          Print("No object to bake");
          return;
        }

        //Make new attribute to set name
        Rhino.DocObjects.ObjectAttributes att = new Rhino.DocObjects.ObjectAttributes();

        string name = names.Count > 0 ? names[i % names.Count] : null;
        //Set object name
        if(!string.IsNullOrEmpty(name))
        {
          att.Name = name;
        }

        Color color = colors.Count > 0 ? colors[i % colors.Count] : new Color();
        //Set color
        if(!color.IsEmpty)
        {
          att.ColorSource = Rhino.DocObjects.ObjectColorSource.ColorFromObject; //Make the color type "by object"
          att.ObjectColor = color;

          att.PlotColorSource = Rhino.DocObjects.ObjectPlotColorSource.PlotColorFromObject; //Make the plot color type "by object"
          att.PlotColor = color;
        }

        string layer = layers.Count > 0 ? layers[i % layers.Count] : null;
        //Set layer
        if(!string.IsNullOrEmpty(layer) && Rhino.DocObjects.Layer.IsValidName(layer))
        {
          //Get the current layer index
          Rhino.DocObjects.Tables.LayerTable layerTable = doc.Layers;
          int layerIndex = layerTable.Find(layer, true);

          if(layerIndex < 0) //This layer does not exist, we add it
          {
            Rhino.DocObjects.Layer onlayer = new Rhino.DocObjects.Layer(); //Make a new layer
            onlayer.Name = layer;

            layerIndex = layerTable.Add(onlayer); //Add the layer to the layer table
            if (layerIndex > -1) //We manged to add layer!
            {
              att.LayerIndex = layerIndex;
              Print("Added new layer to the document at position " + layerIndex + " named " + layer + ". ");
            } else
              Print("Layer did not add. Try cleaning up your layers."); //This never happened to me.
          }
          else
            att.LayerIndex = layerIndex; //We simply add to the existing layer
        }


        double pWidth = pWidths.Count > 0 ? pWidths[i % pWidths.Count] : 0;
        //Set plotweight
        if(pWidth > 0)
        {
          att.PlotWeightSource = Rhino.DocObjects.ObjectPlotWeightSource.PlotWeightFromObject;
          att.PlotWeight = pWidth;
        }


        object material = materials.Count > 0 ? materials[i % materials.Count] : null;
        //Set material
        bool materialByName = !string.IsNullOrEmpty(material as string);
        Rhino.Display.DisplayMaterial inMaterial = material as Rhino.Display.DisplayMaterial;
        if(material is Color)
        {
          inMaterial = new Rhino.Display.DisplayMaterial((Color) material);
        }
        if(material != null && inMaterial == null && !materialByName)
        {
          if(!(material is string))
          {
            try //We also resort to try with IConvertible
            {
              inMaterial = (Rhino.Display.DisplayMaterial) Convert.ChangeType(material, typeof(Rhino.Display.DisplayMaterial));
            }
            catch(InvalidCastException)
            {
            }
          }
        }
        if(inMaterial != null || materialByName)
        {
          string matName;

          if(!materialByName)
          {
            matName = string.Format("A:{0}-D:{1}-E:{2}-S:{3},{4}-T:{5}",
              Format(inMaterial.Ambient),
              Format(inMaterial.Diffuse),
              Format(inMaterial.Emission),
              Format(inMaterial.Specular),
              inMaterial.Shine.ToString(),
              inMaterial.Transparency.ToString()
              );
          }
          else
          {
            matName = (string) material;
          }

          int materialIndex = doc.Materials.Find(matName, true);
          if(materialIndex < 0 && !materialByName) //Material does not exist and we have its specs
          {
            materialIndex = doc.Materials.Add(); //Let's add it
            if(materialIndex > -1)
            {
              Print("Added new material at position " + materialIndex + " named \"" + matName + "\". ");
              Rhino.DocObjects.Material m = doc.Materials[materialIndex];
              m.Name = matName;
              m.AmbientColor = inMaterial.Ambient;
              m.DiffuseColor = inMaterial.Diffuse;
              m.EmissionColor = inMaterial.Emission;
              //m.ReflectionColor = no equivalent
              m.SpecularColor = inMaterial.Specular;
              m.Shine = inMaterial.Shine;
              m.Transparency = inMaterial.Transparency;
              //m.TransparentColor = no equivalent
              m.CommitChanges();

              att.MaterialSource = Rhino.DocObjects.ObjectMaterialSource.MaterialFromObject;
              att.MaterialIndex = materialIndex;
            }
            else
              Print("Material did not add. Try cleaning up your materials."); //This never happened to me.
          }
          else if(materialIndex < 0 && materialByName) //Material does not exist and we do not have its specs. We do nothing
          {
            Print("Warning: material name not found. I cannot set the source to this material name. Add a material with name: " + matName);
          }
          else
          {
            //If this material exists, we do not replace it!
            att.MaterialSource = Rhino.DocObjects.ObjectMaterialSource.MaterialFromObject;
            att.MaterialIndex = materialIndex;
          }
        }


        int wires = wiresEach.Count > 0 ? wiresEach[i % wiresEach.Count] : 0;
        //Set wire density
        if(wires == -1 || wires > 0)
        {
          att.WireDensity = wires;
        }

        Bake(obj, att, groupIndex);
      }
    }
    else
    {
      Print("Inactive");
    }
# ---------- bakeattributes: C# additional code ----------
  void Bake(object obj, Rhino.DocObjects.ObjectAttributes att, int groupIndex)
  {
    if(obj == null)
      return;

    Guid id;

    //Bake to the right type of object
    if(obj is GeometryBase)
    {
      GeometryBase geomObj = obj as GeometryBase;

      switch(geomObj.ObjectType)
      {
        case Rhino.DocObjects.ObjectType.Brep:
          id = doc.Objects.AddBrep(obj as Brep, att);
          break;
        case Rhino.DocObjects.ObjectType.Curve:
          id = doc.Objects.AddCurve(obj as Curve, att);
          break;
        case Rhino.DocObjects.ObjectType.Point:
          id = doc.Objects.AddPoint((obj as Rhino.Geometry.Point).Location, att);
          break;
        case Rhino.DocObjects.ObjectType.Surface:
          id = doc.Objects.AddSurface(obj as Surface, att);
          break;
        case Rhino.DocObjects.ObjectType.Mesh:
          id = doc.Objects.AddMesh(obj as Mesh, att);
          break;
        case (Rhino.DocObjects.ObjectType) 1073741824://Rhino.DocObjects.ObjectType.Extrusion:
          id = (Guid) typeof(Rhino.DocObjects.Tables.ObjectTable).InvokeMember("AddExtrusion", BindingFlags.Instance | BindingFlags.InvokeMethod, null, doc.Objects, new object[]{obj, att});
          break;
        case Rhino.DocObjects.ObjectType.PointSet:
          id = doc.Objects.AddPointCloud(obj as Rhino.Geometry.PointCloud, att); //This is a speculative entry
          break;
        default:
          Print("The script does not know how to handle this type of geometry: " + obj.GetType().FullName);
          return;
      }
    }
    else
    {
      Type objectType = obj.GetType();

      if(objectType == typeof(Arc))
      {
        id = doc.Objects.AddArc((Arc) obj, att);
      }
      else if(objectType == typeof(Box))
      {
        id = doc.Objects.AddBrep(((Box) obj).ToBrep(), att);
      }
      else if(objectType == typeof(Circle))
      {
        id = doc.Objects.AddCircle((Circle) obj, att);
      }
      else if(objectType == typeof(Ellipse))
      {
        id = doc.Objects.AddEllipse((Ellipse) obj, att);
      }
      else if(objectType == typeof(Polyline))
      {
        id = doc.Objects.AddPolyline((Polyline) obj, att);
      }
      else if(objectType == typeof(Sphere))
      {
        id = doc.Objects.AddSphere((Sphere) obj, att);
      }
      else if(objectType == typeof(Point3d))
      {
        id = doc.Objects.AddPoint((Point3d) obj, att);
      }
      else if(objectType == typeof(Line))
      {
        id = doc.Objects.AddLine((Line) obj, att);
      }
      else if(objectType == typeof(Vector3d))
      {
        Print("Impossible to bake vectors");
        return;
      }
      else if(obj is IEnumerable)
      {
        int newGroupIndex;
        if(groupIndex == -1)
          newGroupIndex = doc.Groups.Add();
        else
          newGroupIndex = groupIndex;
        foreach(object o in obj as IEnumerable)
        {
          Bake(o, att, newGroupIndex);
        }
        return;
      }
      else
      {
        Print("Unhandled type: " + objectType.FullName);
        return;
      }
    }

    if(groupIndex != -1)
    {
      doc.Groups.AddToGroup(groupIndex, id);
      Print("Added " + obj.GetType().Name + " to group number " + groupIndex);
    }
    else
      Print("Added " + obj.GetType().Name);
  }

  static string Format(Color c)
  {
    return (new System.Text.StringBuilder("A")).Append(c.A.ToString()).Append("R").Append(c.R.ToString()).Append("G")
      .Append(c.G.ToString()).Append("B").Append(c.B.ToString()).ToString();
  }
# ---------- end bakeattributes ----------
panel_5 = Panel(bakeattributes)

# ==== cluster GetTopPrograms
numberoftopprograms = ClusterInput()
series = Series(Start=0, Step=Slider(1, range=0..10), NumberOfTopPrograms=numberoftopprograms)
listofall = ClusterInput()
item_gettopprogramsused = ListItem(ListOfAll=listofall, Index=series, Wrap=True)
panel = Panel(item_gettopprogramsused)
split_getridofseconds = TextSplit(Text=item_gettopprogramsused, Separators=",")
dispatch = Dispatch(List=split_getridofseconds, DispatchPattern=[True, False])  # -> flatten(ListA), ListB
cset_deleteduplicateprograms = CreateSet(List=flatten(dispatch.ListA))  # -> Set, Map
tsort_makealphabetical = SortText(Keys=cset_deleteduplicateprograms.Set, Culture=127)  # -> flatten(Keys), Values
K = ClusterOutput(tsort_makealphabetical.Keys)

# ==== cluster Parse
allrescuetimedata = ClusterInput()
hourrange = ClusterInput()
allrescuetimedata_2 = Data(allrescuetimedata)
tmatch = MatchText(Text=allrescuetimedata_2, HourRange=hourrange, Case=True)
panel = Panel(tmatch)
panel_2 = Panel(allrescuetimedata_2)
dispatchhourzero = Dispatch(List=allrescuetimedata_2, DispatchPattern=tmatch)  # -> ListA, ListB
rep = ReplaceText(Text=dispatchhourzero.ListA, HourRange=hourrange, RecursiveReplace=False)  # -> simplify(HourCompleteList)
panel_3 = Panel(dispatchhourzero.ListA)
split = TextSplit(Text=rep, Separators=",")
dispatch = Dispatch(List=split, DispatchPattern=[True, False])  # -> Program, SecondsByProgram
path_mapper = PathMapper(dispatch.SecondsByProgram, source="{A;B}", target="{A}")
path_mapper_2 = PathMapper(dispatch.Program, source="{A;B}", target="{A}")
panel_4 = Panel(rep)
panel_5 = Panel(path_mapper)
panel_6 = Panel(path_mapper_2)
smaller = SmallerThan(FirstNumber=panel_5, SecondNumber=Slider(20, range=0..100))  # -> SmallerThan, OrEqualTo
panel_7 = Panel(smaller.SmallerThan)
dispatch_2 = Dispatch(List=path_mapper_2, DispatchPattern=smaller.SmallerThan)  # -> ListA, ListB
panel_8 = Panel(dispatch_2.ListB)
dispatch_3 = Dispatch(List=path_mapper, DispatchPattern=smaller.SmallerThan)  # -> ListA, ListB
dispatch_4 = Dispatch(List=panel_4, DispatchPattern=smaller.SmallerThan)  # -> ListA, ListB
panel_9 = Panel(dispatch_4.ListB)
B = ClusterOutput(dispatch_3.ListB)
program = ClusterOutput(dispatch_2.ListB)
ma = MassAddition(Input=flatten(dispatch_3.ListB))  # -> TotalSecondsUsedInEntireSet, PartialResults
ma_2 = MassAddition(Input=dispatch_3.ListB)  # -> TotalSecondsUsedInHour, PartialResults
panel_10 = Panel(dispatch_3.ListB)
B_2 = ClusterOutput(dispatch_4.ListB)
totalsecondsusedinhour = ClusterOutput(ma_2.TotalSecondsUsedInHour)
totalsecondsusedinentireset = ClusterOutput(ma.TotalSecondsUsedInEntireSet)
panel_11 = Panel(ma_2.TotalSecondsUsedInHour)

# ==== cluster Type
programs_hr = ClusterInput()
panel = Panel(programs_hr)
program = ClusterInput()
tmatch = MatchText(ProgramsHr=programs_hr, Pattern=program, Case=True)
panel_2 = Panel(tmatch)
averagetimeusedperhr = ClusterInput()
dispatch = Dispatch(AverageTimeUsedPerHr=averagetimeusedperhr, DispatchPattern=tmatch)  # -> ListA, ListB
panel_3 = Panel(dispatch.ListA)
null = NullItem(Item=dispatch.ListA)  # -> NullFlags, InvalidFlags, Description
p_n_c = PickNChoose(Pattern=null.NullFlags, Stream0=dispatch.ListA, Stream1="null")
panel_4 = Panel(p_n_c)
rep = ReplaceText(Text=p_n_c, Find="null", Replace="0", RecursiveReplace=False)
R = ClusterOutput(rep)
panel_5 = Panel(rep)

# ==== cluster GraphByHour
programuse = ClusterInput()
multiplier = ClusterInput()
multiplication = Multiplication(ProgramUse=programuse, Multiplier=multiplier)
startingpoints = ClusterInput()
X = UnitX(Factor=flatten(multiplication))
move = Move(StartingPoints=startingpoints, Motion=X)  # -> ResultingPoints, Transform
resultingpoints = ClusterOutput(move.ResultingPoints)
intcrv = Interpolate(Vertices=move.ResultingPoints, Degree=3, Periodic=False, KnotStyle=1)  # -> ResultingCurve, Length, Domain
startingcurve = ClusterInput()
resultingcurve = ClusterOutput(intcrv.ResultingCurve)
loft = Loft(
    StartingCurve=[intcrv.ResultingCurve, startingcurve],
    Options={Adjust=False, Closed=False, LoftEnds=0, LoftSimp=0, LoftType=0, Rebuild=10, Refit=0.01})
loft_2 = ClusterOutput(loft)
